# Dynamo graph Parameter Cleanup.dyn (Dynamo 2.0.2.6826)

code_block = CodeBlock { true; }
familyParameters = Custom[FamilyDocument.FamilyParameters](toggle=code_block)
properties = Custom[FamilyParameter.Properties](familyParameter=familyParameters)

# group: Filter Shared Parameters
filterByBoolMask = List.FilterByBoolMask(list=properties.GUID, mask=properties.IsSharedParameter)

code_block_2 = CodeBlock { "T:\\Revit\\2019\\Shared Parameter - DIALOG.txt"; }
parse = Custom[SharedParameterFile.Parse](path=code_block_2)

# group: Check if in Shared Param File by GUID
string_from_object = FromObject(obj=filterByBoolMask.in)
contains = List.Contains(list=parse.guids, item=string_from_object@L1)
filterByBoolMask_2 = List.FilterByBoolMask(list=filterByBoolMask.in, mask=contains)

crap_guids = Watch(filterByBoolMask_2.out)
watch = Watch(parse.guids)

# group: FIND CRAPPY PARAMETERS AND CONVERT TO FAMILY
filterByBoolMask_3 = List.FilterByBoolMask(list=familyParameters, mask=properties.IsSharedParameter)
filterByBoolMask_4 = List.FilterByBoolMask(list=filterByBoolMask_3.in, mask=contains)
unwanted_shared_parameters = Watch(filterByBoolMask_4.out)

sharedToLocal = ParameterConverter.SharedToLocal(FamilyParameter=unwanted_shared_parameters)
watch_2 = Watch(sharedToLocal.Output)
watch_3 = Watch(sharedToLocal.Messages)
watch_4 = Watch(sharedToLocal.Success)
